# Dynamo graph Select all elements on specific user-created workset.dyn (Dynamo 2.16.2.5624)
# packages: Genius Loci 2024.5.29

user_created_workset = Python()  # CPython3; unwired: IN[0]
# ---------- user_created_workset.python (32 lines) ----------
# Load the Python Standard and DesignScript Libraries
import sys
import clr

clr.AddReference('ProtoGeometry')
from Autodesk.DesignScript.Geometry import *

# Add reference to RevitAPI and RevitServices
clr.AddReference('RevitAPI')
clr.AddReference('RevitServices')

# Import necessary classes
from Autodesk.Revit.DB import FilteredWorksetCollector, WorksetKind
from RevitServices.Persistence import DocumentManager

# Get the current Revit document
doc = DocumentManager.Instance.CurrentDBDocument

# Create a FilteredWorksetCollector
worksetCollector = FilteredWorksetCollector(doc)

# Get all worksets
allWorksets = worksetCollector.ToWorksets()

# Filter to get only user-created worksets
userWorksets = [w for w in allWorksets if w.Kind == WorksetKind.UserWorkset]

# Extract workset names
worksetNames = [w.Name for w in userWorksets]

# Assign your output to the OUT variable.
OUT = worksetNames
# ----------------------------------------
number_slider = DoubleSlider(10, range=0..100 step 0.1)
getItemAtIndex = List.GetItemAtIndex(list=user_created_workset, index=number_slider)
all_elements_at_workset = Custom[All Elements at Workset](workset=getItemAtIndex)  # package Genius Loci; Collect all elements at a given workset. Works with a workset name or with a Autodesk.Revit.DB.Workset.
