# Dynamo graph generates filled regions.dyn (Dynamo 2.16.2.5624)

side_length_of_each_square_in = DoubleSlider(1, range=0..100 step 0.1)  # "Side length of each square in feet"
gap_between_squares_in_feet = DoubleSlider(0.5, range=0..100 step 0.1)
string = StringInput("Drafting 1")
string_2 = StringInput("Arial - 1/8\"")
python_script = Python(IN[0]=side_length_of_each_square_in, IN[1]=gap_between_squares_in_feet, IN[2]=string, IN[3]=string_2)  # CPython3
# ---------- python_script.python (143 lines) ----------
# Import required Revit API namespaces
import clr
clr.AddReference("RevitAPI")
clr.AddReference("RevitServices")
import math
from Autodesk.Revit.DB import *
from Autodesk.Revit.DB import HorizontalTextAlignment
from RevitServices.Persistence import DocumentManager
from RevitServices.Transactions import TransactionManager

# Get the current Revit document
doc = DocumentManager.Instance.CurrentDBDocument

# Input parameters - ensure proper type conversion
try:
    square_size = float(IN[0])  # Convert to float for safety
    gap_size = float(IN[1])     # Convert to float for safety
    drafting_view_name = str(IN[2])  # Convert to string for safety
    text_note_type_name = str(IN[3])  # Name of the text note type to use
except (TypeError, ValueError) as e:
    raise ValueError("Invalid input parameters. Please ensure:\n- Square size is a number\n- Gap size is a number\n- View name is text\n- Text note type name is text")

# Helper function to find text note type by name
def get_text_note_type_by_name(doc, type_name):
    text_note_types = FilteredElementCollector(doc).OfClass(TextNoteType).ToElements()
    for text_type in text_note_types:
        if text_type.get_Parameter(BuiltInParameter.SYMBOL_NAME_PARAM).AsString() == type_name:
            return text_type
    return None

# Helper function to find or create a drafting view
def get_or_create_drafting_view(doc, view_name):
    # Find existing drafting view by name
    collector = FilteredElementCollector(doc).OfClass(ViewDrafting)
    existing_view = next((view for view in collector if view.Name == view_name), None)
    if existing_view:
        return existing_view
        
    # If not found, create a new drafting view
    view_family_types = FilteredElementCollector(doc).OfClass(ViewFamilyType)
    drafting_view_type = next((vft for vft in view_family_types if vft.ViewFamily == ViewFamily.Drafting), None)
    
    if not drafting_view_type:
        raise Exception("No drafting view family type found in the project.")
        
    new_view = ViewDrafting.Create(doc, drafting_view_type.Id)
    new_view.Name = view_name
    return new_view

# Helper function to create a filled region
def create_filled_region(doc, view, rect, filled_region_type):
    curve_loop = CurveLoop()
    for line in rect:
        curve_loop.Append(line)
    return FilledRegion.Create(doc, filled_region_type.Id, view.Id, [curve_loop])

try:
    # Start the transaction
    TransactionManager.Instance.EnsureInTransaction(doc)

    # Get or create the drafting view
    drafting_view = get_or_create_drafting_view(doc, drafting_view_name)
    if not drafting_view:
        raise Exception("Failed to create drafting view.")

    # Get all available filled region types
    filled_region_types = list(FilteredElementCollector(doc).OfClass(FilledRegionType).ToElements())
    if not filled_region_types:
        raise Exception("No filled region types found in the project.")

    # Get the specified text note type
    text_note_type = get_text_note_type_by_name(doc, text_note_type_name)
    if not text_note_type:
        available_types = [t.get_Parameter(BuiltInParameter.SYMBOL_NAME_PARAM).AsString() 
                         for t in FilteredElementCollector(doc).OfClass(TextNoteType).ToElements()]
        raise Exception(f"Text note type '{text_note_type_name}' not found. Available types: {', '.join(available_types)}")

    # Calculate grid dimensions based on the number of filled region types
    total_types = len(filled_region_types)
    n_cols = int(math.ceil(math.sqrt(total_types)))
    n_rows = int(math.ceil(float(total_types) / n_cols))

    # Generate the grid of squares
    squares = []
    text_notes = []
    
    for i in range(n_rows):
        for j in range(n_cols):
            index = i * n_cols + j
            if index >= total_types:
                break
                
            # Calculate square position
            x = j * (square_size + gap_size)
            y = i * (square_size + gap_size)
            
            # Create square geometry
            points = [
                XYZ(x, y, 0),
                XYZ(x + square_size, y, 0),
                XYZ(x + square_size, y + square_size, 0),
                XYZ(x, y + square_size, 0)
            ]
            
            # Create lines for the square
            rect = [Line.CreateBound(points[k], points[(k+1)%4]) for k in range(4)]
            
            # Create filled region
            filled_region_type = filled_region_types[index]
            filled_region = create_filled_region(doc, drafting_view, rect, filled_region_type)
            squares.append(filled_region)
            
            # Get pattern information
            filled_region_type_name = str(filled_region_type.get_Parameter(BuiltInParameter.SYMBOL_NAME_PARAM).AsString())
            
            # Get fill pattern name safely
            fill_pattern_id = filled_region_type.ForegroundPatternId
            fill_pattern_element = doc.GetElement(fill_pattern_id)
            fill_pattern_name = "No Pattern"
            if fill_pattern_element and hasattr(fill_pattern_element, "Name"):
                fill_pattern_name = str(fill_pattern_element.Name)
            
            # Create text note
            text_content = "{}\nPattern: {}".format(filled_region_type_name, fill_pattern_name)
            text_point = XYZ(x + square_size / 2, y - gap_size / 2, 0)
            
            # Create text note with options
            text_note_opts = TextNoteOptions(text_note_type.Id)
            text_note_opts.HorizontalAlignment = HorizontalTextAlignment.Center
            
            text_note = TextNote.Create(doc, drafting_view.Id, text_point, text_content, text_note_opts)
            text_notes.append(text_note)

    # Commit the transaction
    TransactionManager.Instance.TransactionTaskDone()
    OUT = (squares, text_notes)

except Exception as e:
    # Ensure transaction is closed even if there's an error
    if TransactionManager.Instance.CurrentTransaction:
        TransactionManager.Instance.TransactionTaskDone()
    # Re-raise the exception with more context
    raise Exception("Error in pattern grid creation: {}".format(str(e)))
# ----------------------------------------
number_of_squares_along_one_axis = IntegerSlider(15, range=0..100 step 1)
